# Grasshopper definition Latent Space.gh (Grasshopper 1.0.7)
# plug-ins: SonicMat, GH_CPython, Bifocals

number_slider = Slider(3, range=2..3)
encoder = Encoder(
    num_components_input=Slider(3, range=2..3),
    n_dim_input=number_slider,
    perplexity_input=Slider(22, range=0..100),
    learning_rate_input=Slider(100, range=0..100),
    scale_input=Slider(7, range=0..10))  # -> pts_output, dir_output; inputs num_components_input: list, n_dim_input: list, perplexity_input: list, learning_rate_input: list, scale_input: list
#   port pts_output: indicate your output description here. refers to a new line.
# ---------- encoder: Python ----------
# -*- coding: utf-8 -*- 
"""
Python Script for Grasshopper Latent Space Visualisation
Created on Monday October 2024 01:49:03 
@author: willi 
"""

import os
import numpy as np
import cv2 as cv
from skimage import color
from sklearn.decomposition import PCA
from sklearn import manifold
from glob import glob
import time

# Inputs from Grasshopper:
# Ensure these variables match the inputs connected in Grasshopper
# folder_path = folder_path_input  # Input folder path from the Grasshopper panel
folder_path = r'E:\UCL\3_RC18\Term_2\1_GenAI\data\0_Total\test2'

num_components = num_components_input  # PCA components from number slider
n_dim = n_dim_input                    # t-SNE components (3D visualisation) from slider
perplexity = perplexity_input          # t-SNE perplexity from number slider
learning_rate = learning_rate_input    # t-SNE learning rate from number slider
scale = scale_input                    # Scaling factor for 3D points from slider

# Reading image files
image_files = glob(os.path.join(folder_path, '*.png'))  # Fetch all jpg images
num_imgs = len(image_files)  # Count number of images

# Ensure there are images to process
if num_imgs == 0:
    raise ValueError("No images found in the folder.")

# Process images and prepare the stack for PCA
im_stack = []

for img_path in image_files:
    img = cv.imread(img_path)
    if img is not None:
        # Convert to greyscale
        img_gray = color.rgb2gray(img)
        
        # Resize to 256x256
        new_size = (256, 256)
        img_gray = cv.resize(img_gray, new_size, interpolation=cv.INTER_AREA)
        
        # Flatten the image and append to stack
        im_stack.append(img_gray.flatten())

# Convert the stack to a NumPy array
im_stack = np.array(im_stack)

# Perform PCA for dimensionality reduction
pca = PCA(n_components=num_components)
low_matrix = pca.fit_transform(im_stack)

# t-SNE for further reduction to 3D coordinates
tsne = manifold.TSNE(n_components=n_dim, init='pca', random_state=0, perplexity=perplexity, learning_rate=learning_rate)
X_tsne = tsne.fit_transform(low_matrix)  # Apply t-SNE on PCA-reduced data
X_tsne = X_tsne * scale  # Optionally scale the coordinates

# Output: 3D coordinates for each image (to be visualised in Grasshopper)
output_points = X_tsne.tolist()  # Convert NumPy array to list for GH output

# Pass the 3D coordinates to Grasshopper for visualisation as points
pts_output = output_points

# Optionally, print the result
for i, pt in enumerate(pts_output):
    print("Image {} 3D coordinates: {}".format(i+1, pt))

#-------------------------------

# List out all the contents in the folder (no need to modify)
dir_files = os.listdir(folder_path)

dir_output = []
for file in dir_files:
    dir_output.append(os.path.join(folder_path, file))

print(dir_output)
# ---------- end encoder ----------
panel = Panel(encoder.dir_output)
panel_2 = Panel(encoder.pts_output)
text_split = TextSplit(Text=panel, Separators="'")  # -> simplify(Result)
panel_3 = Panel(text_split)
partition_list = PartitionList(List=panel_2, Size=number_slider)
list_item = ListItem(List=panel_3, Index="1", Wrap=True)  # -> flatten(Item)
list_item_2 = ListItem(List=partition_list, Index=2, Wrap=True)
list_item_3 = ListItem(List=partition_list, Index=0, Wrap=True)
list_item_4 = ListItem(List=partition_list, Index=1, Wrap=True)
construct_point = ConstructPoint(XCoordinate=list_item_3, YCoordinate=list_item_4, ZCoordinate=list_item_2)
panel_4 = Panel(list_item)
panel_5 = Panel(construct_point)

series = Series(Start="50", Step="1", Count="50")
panel_6 = Panel(series)
list_item_5 = ListItem(List=flatten(construct_point), Index=series, Wrap=Toggle(True))
line = Line(StartPoint=panel_5, EndPoint=list_item_5)
custom_preview = CustomPreview(Geometry=list_item_5, Material=ColourSwatch(SwatchColor=RGB(255, 0, 0)))
custom_preview_2 = CustomPreview(Geometry=line, Material=ColourSwatch(SwatchColor=RGB(219, 61, 182)))

# ---- group: 起点位置
number_slider_2 = Slider(1339, range=0..2000)

# ---- group: 最短路径
shift_list = ShiftList(List=construct_point, Shift=1, Wrap=True)
distance = Distance(PointA=flatten(construct_point), PointB=shift_list)  # -> flatten(Distance)
number_slider_3 = Slider(1, range=0..1)
bounds = Bounds(Numbers=distance)
panel_7 = Panel(bounds)
line_2 = Line(StartPoint=flatten(construct_point), EndPoint=shift_list)  # -> flatten(Line)
panel_8 = Panel(line_2)
smaller_than = SmallerThan(FirstNumber=distance, SecondNumber=Slider(158.302, range=0..500))  # -> SmallerThan, OrEqualTo
list_item_6 = ListItem(List=line_2, Index=number_slider_2, Wrap=True)
cull_pattern = CullPattern(List=line_2, CullPattern=smaller_than.SmallerThan)
custom_preview_3 = CustomPreview(Geometry=list_item_6, Material=ColourSwatch(SwatchColor=RGB(0, 255, 234)))
custom_preview_4 = CustomPreview(Geometry=cull_pattern, Material=ColourSwatch(SwatchColor=RGB(13, 166, 158)))

# ---- group: 每张图片的尺寸
scale = Slider(35, range=0..100)
center_box = CenterBox(Base=construct_point, X=scale, Y=scale, Z=0)
material = Material(Surface=flatten(center_box), String=panel_4, Double=Slider(0, range=0..100))

# ---- group: 点走的路径 / 点的移动位置
number_slider_4 = Slider(1, range=0..1)

# ---- group: 点走的路径
end = EndPoints(Curve=list_item_6)  # -> Start, End
pdecon = Deconstruct(Point=end.Start)  # -> XComponent, YComponent, ZComponent
pdecon_2 = Deconstruct(Point=end.End)  # -> XComponent, YComponent, ZComponent
eval = Evaluate(F="x + (y-x)*z", x=pdecon.XComponent, y=pdecon_2.XComponent, z=number_slider_4)
eval_2 = Evaluate(F="x + (y-x)*z", x=pdecon.YComponent, y=pdecon_2.YComponent, z=number_slider_4)
eval_3 = Evaluate(F="x + (y-x)*z", x=pdecon.ZComponent, y=pdecon_2.ZComponent, z=number_slider_4)
panel_9 = Panel(eval)
panel_10 = Panel(eval_2)
panel_11 = Panel(eval_3)
pt = ConstructPoint(XCoordinate=panel_9, YCoordinate=panel_10, ZCoordinate=panel_11)
sphere = Sphere(Base=pt, Radius=Slider(8, range=0..50))
custom_preview_5 = CustomPreview(Geometry=sphere, Material=ColourSwatch(SwatchColor=RGB(187, 78, 207)))
